# Grasshopper definition 08.06.01. Intro_2nd_Draft.gh (Grasshopper 1.0.7)
# plug-ins: RhinoCodePluginGH

# This Grasshopper definition
# was developed by Michael Wickerson
# ✉ https://wickersonstudios.com/contact
# 08.06. C# and Chat GPT-4
# Copyright (C) 2023 - LEARNGRASSHOPPER.COM
# 08.06.01. Point Geometries
# 08.06.01. Intro
# About Michael
# Intro to Rhino 8 and new script editor
# Explain Why C# and why to use GPT-4
# First Script - Point and array of points
# gpt-4 Initial Response
# gpt-4 Text Prompt
# Use this script editor template to create a script
#  for the C# node in grasshopper for rhino8 that
# models geometry for the
# 
# GEOMETRY
# 
# and specifically the
# 
# Create Point and Array of Points
# 
# //Grasshopper Script Instance
# //#! csharp
# using System;
# using System.Collections;
# using System.Collections.Generic;
# using System.Drawing;
# 
# using Rhino;
# using Rhino.Geometry;
# 
# using Grasshopper;
# using Grasshopper.Kernel;
# using Grasshopper.Kernel.Data;
# using Grasshopper.Kernel.Types;
# 
# public class Script_Instance : GH_ScriptInstance
# {
#   /*
#     Members:
#       RhinoDoc RhinoDocument
#       GH_Document GrasshopperDocument
#       IGH_Component Component
#       int Iteration
# 
#     Methods (Virtual & overridable):
#       Print(string text)
#       Print(string format, params object[] args)
#       Reflect(object obj)
#       Reflect(object obj, string method_name)
#   */
# 
#   private void RunScript(object x, object y, out object a)
#   {
#     // Write your logic here
#     a = null;
#   }
# }
script = Script()  # -> out, a
# ---------- script: C# ----------
// Grasshopper Script Instance
//#! csharp
using System;
using System.Collections;
using System.Collections.Generic;
using System.Drawing;

using Rhino;
using Rhino.Geometry;

using Grasshopper;
using Grasshopper.Kernel;
using Grasshopper.Kernel.Data;
using Grasshopper.Kernel.Types;

public class Script_Instance : GH_ScriptInstance
{
  /* 
    Members:
      RhinoDoc RhinoDocument
      GH_Document GrasshopperDocument
      IGH_Component Component
      int Iteration

    Methods (Virtual & overridable):
      Print(string text)
      Print(string format, params object[] args)
      Reflect(object obj)
      Reflect(object obj, string method_name)
  */
  
  private void RunScript(object x, object y, out object a)
  {
    // Write your logic here
    a = null;
  }
}
# ---------- end script ----------

# ----
# 2nd gpt-4 Text Prompt
# gpt-4 Initial Response
# Certainly! To create a grid of points, you will
# typically need two more input parameters:
# rowCount and columnCount to define the
# number of rows and columns in the grid. Then
# you can iterate over the rows and columns to
# create points at each grid position.
# Great, now make the script much more complex model
# with C# script and Rhino common API.
# 
# Be sure to incorporate the previous code logic.
# ensure that this script produces 3d geometry as
# well for Data visualization purposes.
# ADVANCED  SCRIPT
number_slider = Slider(12, range=0..100)
# gpt-4 Transcript link:
# 
# https://chat.openai.com/share/4a910de0-41b6-4078-8b45-aa97c646b7f8
number_slider_2 = Slider(2, range=0..10)
point_geometries = Script(
    x=number_slider,
    y=Slider(12, range=0..100),
    z=Slider(12, range=0..100),
    number=Slider(7, range=0..10),
    rowCount=Slider(7, range=0..10),
    columnCount=Slider(4, range=0..10),
    spacing=number_slider_2)  # -> out, singlePoint, arrayOfPoints, gridOfPoints; inputs x: Double, y: Double, z: Double, number: Int32, rowCount: Int32, columnCount: Int32, spacing: Double
# ---------- point_geometries: C# ----------
// Grasshopper Script Instance
//#! csharp
using System;
using System.Collections;
using System.Collections.Generic;
using System.Drawing;

using Rhino;
using Rhino.Geometry;

using Grasshopper;
using Grasshopper.Kernel;
using Grasshopper.Kernel.Data;
using Grasshopper.Kernel.Types;

public class Script_Instance : GH_ScriptInstance
{
    private void RunScript(double x, double y, double z, int number, int rowCount, int columnCount, double spacing, out object singlePoint, out object arrayOfPoints, out object gridOfPoints)
    {
        // Create a single point
        Point3d pt = new Point3d(x, y, z);
        singlePoint = pt;
        
        // Create an array (List) of points
        List<Point3d> points = new List<Point3d>();
        for(int i = 0; i < number; i++)
        {
            points.Add(new Point3d(i, i, i)); // You can change the coordinates as needed
        }
        arrayOfPoints = points;
        
        // Create a grid of points
        List<Point3d> gridPoints = new List<Point3d>();
        for (int i = 0; i < rowCount; i++)
        {
            for (int j = 0; j < columnCount; j++)
            {
                Point3d gridPt = new Point3d(i * spacing, j * spacing, 0); // z-coordinate is 0, can be changed as needed
                gridPoints.Add(gridPt);
            }
        }
        gridOfPoints = gridPoints;
    }
}
# ---------- end point_geometries ----------
geometry = Geometry(point_geometries.gridOfPoints)
geometry_2 = Geometry(point_geometries.singlePoint)
geometry_3 = Geometry(point_geometries.arrayOfPoints)
panel = Panel(point_geometries.out)
entwine = Entwine(Branch00=geometry_2, Branch01=geometry_3, Branch02=geometry, FlattenInputs=True)
panel_2 = Panel(entwine)

# ----
# Certainly! If the task is to create a Point and an
# Array of Points in Grasshopper using the C#
# component, below is how you can implement it.
# This implementation involves creating a Point3d
# for a single point and a List<Point3d> for an
# array of points.
# 
# I'm assuming that you want the user to input x,
# y, and z as double parameters for creating a
# single point, and number as the number of
# points you want in the array of points.
# BASIC SCRIPT
number_slider_3 = Slider(12, range=0..100)  # disabled
number_slider_4 = Slider(12, range=0..100)  # disabled
number_slider_5 = Slider(12, range=0..100)  # disabled
number_slider_6 = Slider(7, range=0..10)  # disabled
point_geometries_2 = Script(x=number_slider_3, y=number_slider_4, z=number_slider_5, number=number_slider_6)  # -> out, singlePoint, arrayOfPoints; inputs x: Double, y: Double, z: Double, number: Int32; disabled
# ---------- point_geometries_2: C# ----------
// Grasshopper Script Instance
//#! csharp
using System;
using System.Collections;
using System.Collections.Generic;
using System.Drawing;

using Rhino;
using Rhino.Geometry;

using Grasshopper;
using Grasshopper.Kernel;
using Grasshopper.Kernel.Data;
using Grasshopper.Kernel.Types;

public class Script_Instance : GH_ScriptInstance
{
    private void RunScript(double x, double y, double z, int number, out object singlePoint, out object arrayOfPoints)
    {
        // Create a single point
        Point3d pt = new Point3d(x, y, z);
        singlePoint = pt;
        
        // Create an array (List) of points
        List<Point3d> points = new List<Point3d>();
        for(int i = 0; i < number; i++)
        {
            points.Add(new Point3d(i, i, i)); // You can change the coordinates as needed
        }
        
        arrayOfPoints = points;
    }
}
# ---------- end point_geometries_2 ----------
geometry_4 = Geometry(point_geometries_2.singlePoint)  # disabled
geometry_5 = Geometry(point_geometries_2.arrayOfPoints)  # disabled
panel_3 = Panel(point_geometries_2.out)  # disabled
entwine_2 = Entwine(Branch00=geometry_4, Branch01=geometry_5, FlattenInputs=True)  # disabled
panel_4 = Panel(entwine_2)  # disabled
