# Grasshopper definition 08.06.01. Intro_FinalDraft.gh (Grasshopper 1.0.7)
# plug-ins: RhinoCodePluginGH, Bifocals

# This Grasshopper definition
# was developed by Michael Wickerson
# ✉ https://wickersonstudios.com/contact
# 08.06. C# and Chat GPT-4
# Copyright (C) 2023 - LEARNGRASSHOPPER.COM
# 08.06.01. Intro and Point Geometries
# 08.06.01. Intro
# About Michael
# Intro to Rhino 8 and new script editor
# Explain Why C# and why to use GPT-4
# First Script - Point and array of points
# gpt-4 Initial Response
# 
# You can follow the below code to create a point,
# an array of points, and a grid of points. You will
# have to fill up the RunScript method with the
# logic. You can define the input parameters, data
#  types, and also the output parameters based
# on your requirement.
# 
# I'm creating a sample script where x is the count
# of points in the array, y is the spacing between
# the points in the grid, and a will output the grid
# of points.
# gpt-4 Text Prompt
# Use this script editor template to create a script
#  for the C# node in grasshopper for rhino8 that
# models geometry for the
# 
# point scripts
# 
# and specifically to
# 
# create a point, an array of points, and a grid of point
# 
# //Grasshopper Script Instance
# //#! csharp
# using System;
# using System.Collections;
# using System.Collections.Generic;
# using System.Drawing;
# 
# using Rhino;
# using Rhino.Geometry;
# 
# using Grasshopper;
# using Grasshopper.Kernel;
# using Grasshopper.Kernel.Data;
# using Grasshopper.Kernel.Types;
# 
# public class Script_Instance : GH_ScriptInstance
# {
#   /*
#     Members:
#       RhinoDoc RhinoDocument
#       GH_Document GrasshopperDocument
#       IGH_Component Component
#       int Iteration
# 
#     Methods (Virtual & overridable):
#       Print(string text)
#       Print(string format, params object[] args)
#       Reflect(object obj)
#       Reflect(object obj, string method_name)
#   */
# 
#   private void RunScript(object x, object y, out object a)
#   {
#     // Write your logic here
#     a = null;
#   }
# }
script = Script()  # -> out, a
# ---------- script: C# ----------
// Grasshopper Script Instance
//#! csharp
using System;
using System.Collections;
using System.Collections.Generic;
using System.Drawing;

using Rhino;
using Rhino.Geometry;

using Grasshopper;
using Grasshopper.Kernel;
using Grasshopper.Kernel.Data;
using Grasshopper.Kernel.Types;

public class Script_Instance : GH_ScriptInstance
{
  /* 
    Members:
      RhinoDoc RhinoDocument
      GH_Document GrasshopperDocument
      IGH_Component Component
      int Iteration

    Methods (Virtual & overridable):
      Print(string text)
      Print(string format, params object[] args)
      Reflect(object obj)
      Reflect(object obj, string method_name)
  */
  
  private void RunScript(object x, object y, out object a)
  {
    // Write your logic here
    a = null;
  }
}
# ---------- end script ----------
# gpt-4 Initial Response
# 2nd gpt-4 Text Prompt
# Doubleclick Me!
# Great, now make the script much more complex model
# with C# script and Rhino common API.
# 
# Be sure to incorporate the previous code logic.
# ensure that this script produces 3d geometry as
# well for Data visualization purposes.
# ADVANCED  SCRIPT
# gpt-4 Transcript link:
# 
# https://chat.openai.com/share/00423d6a-e74d-427c-b735-e883e10cf61c
number_slider = Slider(4.99, range=0..10)
# BASIC SCRIPT
number_slider_2 = Slider(12, range=0..100)
point_geometries = Script(x=number_slider_2, y=number_slider)  # -> out, singlePoint, pointArray, pointGrid; inputs x: Int32, y: Double
# ---------- point_geometries: C# ----------
//Grasshopper Script Instance
//#! csharp
using System;
using System.Collections;
using System.Collections.Generic;
using System.Drawing;

using Rhino;
using Rhino.Geometry;

using Grasshopper;
using Grasshopper.Kernel;
using Grasshopper.Kernel.Data;
using Grasshopper.Kernel.Types;

using System;
using System.Collections.Generic;
using System.Linq;
using Rhino.Geometry;

public class Script_Instance : GH_ScriptInstance
{
  private void RunScript(int x, double y, out object singlePoint, out object pointArray, out object pointGrid)
  {
    // Ensure x is more than 0 to avoid errors.
    if(x <= 0) 
    {
      singlePoint = Point3d.Unset;
      pointArray = new List<Point3d>();
      pointGrid = new List<Point3d>();
      return;
    }

    // Creating a single point
    singlePoint = new Point3d(0, 0, 0);
    Print($"Single Point Created at {singlePoint}");

    // Creating an array of points
    pointArray = Enumerable.Range(0, x).Select(i => new Point3d(i * y, 0, 0)).ToList();
    Print($"Array of {x} Points Created");

    // Creating a grid of points using LINQ
    pointGrid = Enumerable.Range(0, x)
                   .SelectMany(i => Enumerable.Range(0, x), 
                               (i, j) => new Point3d(i * y, j * y, 0))
                   .ToList();

    Print($"Grid of Points Created with {x * x} Points");
  }
}
# ---------- end point_geometries ----------
panel = Panel(point_geometries.out)
geometry = Geometry(point_geometries.pointArray)
geometry_2 = Geometry(point_geometries.pointGrid)
geometry_3 = Geometry(point_geometries.singlePoint)
entwine = Entwine(Branch00=geometry_3, Branch01=geometry, Branch02=geometry_2, FlattenInputs=True)
panel_2 = Panel(entwine)
