# Grasshopper definition 08.06.01. Intro_test.gh (Grasshopper 1.0.7)
# plug-ins: RhinoCodePluginGH, Bifocals

# This Grasshopper definition
# was developed by Michael Wickerson
# ✉ https://wickersonstudios.com/contact
# 08.06. C# and Chat GPT-4
# Copyright (C) 2023 - LEARNGRASSHOPPER.COM
# 08.06.01. Intro
# 08.06.01. Intro
# About Michael
# Intro to Rhino 8 and new script editor
# Explain Why C# and why to use GPT-4
# First Script - Point and array of points
# gpt-4 Initial Response
# gpt-4 Text Prompt
# To create points and array of points in
# Grasshopper for Rhino using the provided
# template, you will generally define the points
# within the RunScript method. The Create Point
# usually requires x, y, and z coordinates, and
# Array of Points could mean creating a list of
# those points. Below is a basic example where I
# use a list to hold multiple Point3d objects,
# representing an array of points.
# 
# This example assumes you want to create a
# point with the given x and y input and then
# create an array of points in a grid pattern around
#  that point. If x or y are not numeric, you can
# change the input type or do the necessary
# conversion inside the script.
# Use this script editor template to create a script
#  for the C# node in grasshopper for rhino8 that
# models geometry for the
# 
# GEOMETRY
# 
# and specifically the
# 
# Create Point and Array of Points
# 
# //Grasshopper Script Instance
# //#! csharp
# using System;
# using System.Collections;
# using System.Collections.Generic;
# using System.Drawing;
# 
# using Rhino;
# using Rhino.Geometry;
# 
# using Grasshopper;
# using Grasshopper.Kernel;
# using Grasshopper.Kernel.Data;
# using Grasshopper.Kernel.Types;
# 
# public class Script_Instance : GH_ScriptInstance
# {
#   /*
#     Members:
#       RhinoDoc RhinoDocument
#       GH_Document GrasshopperDocument
#       IGH_Component Component
#       int Iteration
# 
#     Methods (Virtual & overridable):
#       Print(string text)
#       Print(string format, params object[] args)
#       Reflect(object obj)
#       Reflect(object obj, string method_name)
#   */
# 
#   private void RunScript(object x, object y, out object a)
#   {
#     // Write your logic here
#     a = null;
#   }
# }
script = Script()  # -> out, a
# ---------- script: C# ----------
// Grasshopper Script Instance
//#! csharp
using System;
using System.Collections;
using System.Collections.Generic;
using System.Drawing;

using Rhino;
using Rhino.Geometry;

using Grasshopper;
using Grasshopper.Kernel;
using Grasshopper.Kernel.Data;
using Grasshopper.Kernel.Types;

public class Script_Instance : GH_ScriptInstance
{
  /* 
    Members:
      RhinoDoc RhinoDocument
      GH_Document GrasshopperDocument
      IGH_Component Component
      int Iteration

    Methods (Virtual & overridable):
      Print(string text)
      Print(string format, params object[] args)
      Reflect(object obj)
      Reflect(object obj, string method_name)
  */
  
  private void RunScript(object x, object y, out object a)
  {
    // Write your logic here
    a = null;
  }
}
# ---------- end script ----------
# BASIC SCRIPT
number_slider = Slider(0, range=0..100)
# gpt-4 Initial Response
# 2nd gpt-4 Text Prompt
number_slider_2 = Slider(12, range=0..100)
# Let's create a more complex model which can
# generate 3D geometrical shapes like spheres at
#  each point location, and we will use different
# sizes and colors to visualize data related to
# each point. For simplicity, let’s assume we are
# visualizing a hypothetical scalar value at each
# point which can be represented by the size and
#  color of the sphere. This scalar value can be
# replaced with any real-world data you are
# working with.
# 
# Here's an enhanced version of the previous
# script that creates spheres at each point, with
# the sphere’s radius and color representing some
#  scalar value.
# Great, now make the script much more complex model
# with C# script and Rhino common API.
# 
# Be sure to incorporate the previous code logic.
# ensure that this script produces 3d geometry as
# well for Data visualization purposes.
# ADVANCED  SCRIPT
number_slider_3 = Slider(0, range=0..100)
# gpt-4 Transcript link:
# 
# https://chat.openai.com/share/45eff5cd-9486-4c11-b30d-5ce4060fd064
number_slider_4 = Slider(11, range=0..100)
array_of_points = Script(x=number_slider, y=Slider(0, range=0..100), gridSize=Slider(10, range=0..100), spacing=number_slider_2)  # -> out, points; inputs x: Double, y: Double, gridSize: Int32, spacing: Double
# ---------- array_of_points: C# ----------
// Grasshopper Script Instance
//#! csharp
using System;
using System.Collections;
using System.Collections.Generic;
using System.Drawing;

using Rhino;
using Rhino.Geometry;

using Grasshopper;
using Grasshopper.Kernel;
using Grasshopper.Kernel.Data;
using Grasshopper.Kernel.Types;

//#! csharp
using System;
using System.Collections.Generic;

public class Script_Instance : GH_ScriptInstance
{
  private void RunScript(double x, double y, int gridSize, double spacing, out object points)
  {
    // Create a single point
    Point3d basePoint = new Point3d(x, y, 0);
    
    // Initialize list to hold array of points
    List<Point3d> pointArray = new List<Point3d>();
    
    // Create an array of points in a grid pattern around the base point
    for(int i = -gridSize; i <= gridSize; i++)
    {
      for(int j = -gridSize; j <= gridSize; j++)
      {
        // Calculate the coordinates for each point in the grid
        double newX = x + i * spacing;
        double newY = y + j * spacing;
        
        // Create a new point and add it to the list
        Point3d newPoint = new Point3d(newX, newY, 0);
        pointArray.Add(newPoint);
      }
    }
    
    // Assign the array of points to the output
    points = pointArray;
  }
}
# ---------- end array_of_points ----------
array_of_points_2 = Script(x=number_slider_3, y=Slider(0, range=0..100), gridSize=Slider(11, range=0..100), spacing=number_slider_4)  # -> out, geometries, colors; inputs x: Double, y: Double, gridSize: Int32, spacing: Double
# ---------- array_of_points_2: C# ----------
// Grasshopper Script Instance
//#! csharp
using System;
using System.Collections;
using System.Collections.Generic;
using System.Drawing;

using Rhino;
using Rhino.Geometry;

using Grasshopper;
using Grasshopper.Kernel;
using Grasshopper.Kernel.Data;
using Grasshopper.Kernel.Types;

//#! csharp
using System;
using System.Collections.Generic;
using System.Drawing; // For Color

using Rhino;
using Rhino.Geometry;

using Grasshopper.Kernel;
using Grasshopper.Kernel.Types;

public class Script_Instance : GH_ScriptInstance
{
  private void RunScript(double x, double y, int gridSize, double spacing, out object geometries, out object colors)
  {
    Random rnd = new Random(); // To generate random scalar values for illustration
    
    // Create a single base point
    Point3d basePoint = new Point3d(x, y, 0);
    
    // Initialize list to hold array of points and geometries
    List<GeometryBase> geometryList = new List<GeometryBase>();
    List<Color> colorList = new List<Color>();
    
    // Create an array of points in a grid pattern around the base point
    for(int i = -gridSize; i <= gridSize; i++)
    {
      for(int j = -gridSize; j <= gridSize; j++)
      {
        double newX = x + i * spacing;
        double newY = y + j * spacing;
        
        // Generate a random scalar value between 1 and 10
        double scalarValue = rnd.Next(1, 11);
        
        // Create a sphere at each point with a radius corresponding to the scalar value
        Point3d newPoint = new Point3d(newX, newY, 0);
        Sphere sphere = new Sphere(newPoint, scalarValue);
        
        // Create a color based on the scalar value (e.g., more red for higher values)
        Color color = Color.FromArgb(255, (int) (scalarValue * 25), 0, 0);
        
        // Add the sphere and color to the lists
        geometryList.Add(sphere.ToBrep());
        colorList.Add(color);
      }
    }
    
    // Assign the lists to the outputs
    geometries = geometryList;
    colors = colorList;
  }
}
# ---------- end array_of_points_2 ----------
panel = Panel(array_of_points.out)
geometry = Geometry(array_of_points.points)
panel_2 = Panel(array_of_points_2.out)
geometry_2 = Geometry(array_of_points_2.geometries)
entwine = Entwine(Branch00=geometry, FlattenInputs=True)
custom_preview = CustomPreview(Geometry=graft(geometry_2), Material=graft(array_of_points_2.colors))
entwine_2 = Entwine(Branch00=geometry_2, Branch01=array_of_points_2.colors, FlattenInputs=True)
panel_3 = Panel(entwine)
panel_4 = Panel(entwine_2)
