# Grasshopper definition 08.06.02. 2D Geometry_FinalDraft.gh (Grasshopper 1.0.7)
# plug-ins: RhinoCodePluginGH, Bifocals

# This Grasshopper definition
# was developed by Michael Wickerson
# ✉ https://wickersonstudios.com/contact
# 08.06. C# and Chat GPT-4
# 08.06.02. 2D Geometry
# Simple scripts:Line, Curves, Circles, Rectangular
# gpt-4 Text Prompt
# Use this script editor template to create a script
#  for the C# node in grasshopper for rhino8 that
# models geometry for the
# 
# GEOMETRY
# 
# and specifically to
# 
# creates a lines, curves, circles, and rectangles
# 
# //Grasshopper Script Instance
# //#! csharp
# using System;
# using System.Collections;
# using System.Collections.Generic;
# using System.Drawing;
# 
# using Rhino;
# using Rhino.Geometry;
# 
# using Grasshopper;
# using Grasshopper.Kernel;
# using Grasshopper.Kernel.Data;
# using Grasshopper.Kernel.Types;
# 
# public class Script_Instance : GH_ScriptInstance
# {
#   /*
#     Members:
#       RhinoDoc RhinoDocument
#       GH_Document GrasshopperDocument
#       IGH_Component Component
#       int Iteration
# 
#     Methods (Virtual & overridable):
#       Print(string text)
#       Print(string format, params object[] args)
#       Reflect(object obj)
#       Reflect(object obj, string method_name)
#   */
# 
#   private void RunScript(object x, object y, out object a)
#   {
#     // Write your logic here
#     a = null;
#   }
# }
script = Script()  # -> out, a
# ---------- script: C# ----------
// Grasshopper Script Instance
//#! csharp
using System;
using System.Collections;
using System.Collections.Generic;
using System.Drawing;

using Rhino;
using Rhino.Geometry;

using Grasshopper;
using Grasshopper.Kernel;
using Grasshopper.Kernel.Data;
using Grasshopper.Kernel.Types;

public class Script_Instance : GH_ScriptInstance
{
  /* 
    Members:
      RhinoDoc RhinoDocument
      GH_Document GrasshopperDocument
      IGH_Component Component
      int Iteration

    Methods (Virtual & overridable):
      Print(string text)
      Print(string format, params object[] args)
      Reflect(object obj)
      Reflect(object obj, string method_name)
  */
  
  private void RunScript(object x, object y, out object a)
  {
    // Write your logic here
    a = null;
  }
}
# ---------- end script ----------

# ----
# BASIC SCRIPT
# 2nd gpt-4 Text Prompt
# Great, now make the script much more complex model
# with C# script and Rhino common API.
# 
# Be sure to incorporate the previous code logic.
# ensure that this script produces 3d geometry as
# well for Data visualization purposes.
# gpt-4 Transcript link:
# 
# https://chat.openai.com/share/efd5d659-6339-445f-8660-22893dc3016f
number_slider = Slider(7.55, range=0..10)
# gpt-4 Initial Response
# Doubleclick Me!
number_slider_2 = Slider(6.05, range=0..10)
# gpt-4 Initial Response
# Certainly! Below is a modified version of the
# template you provided, which creates a line, a
# curve, a circle, and a rectangle. This example
# assumes that you have an input of x as a
# Point3d for the starting point of the line and the
# center of the circle, y as Point3d for the ending
# point of the line and one corner of the rectangle,
#  and r as a number for the radius of the circle.
construct_point = ConstructPoint(XCoordinate=0, YCoordinate=0, ZCoordinate=0)
construct_point_2 = ConstructPoint(XCoordinate=number_slider, YCoordinate=number_slider, ZCoordinate=0)
_2d_geometries = Script(x=construct_point, y=construct_point_2, r=number_slider_2)  # -> out, Line, Curve, Circle, Rectangle; inputs x: Point3d, y: Point3d, r: Double
# ---------- _2d_geometries: C# ----------
// Grasshopper Script Instance
//#! csharp
using System;
using System.Collections;
using System.Collections.Generic;
using System.Drawing;

using Rhino;
using Rhino.Geometry;

using Grasshopper;
using Grasshopper.Kernel;
using Grasshopper.Kernel.Data;
using Grasshopper.Kernel.Types;

public class Script_Instance : GH_ScriptInstance
{
  private void RunScript(Rhino.Geometry.Point3d x, Rhino.Geometry.Point3d y, double r, out object Line, out object Curve, out object Circle, out object Rectangle)
  {
    // Initialize out parameters
    Line = null;
    Curve = null;
    Circle = null;
    Rectangle = null;
    
    try
    {
      // Create a Line
      Line = new Line(x, y);
      
      // Create a Curve from Line
      Curve = new LineCurve((Line)Line);
      
      // Create a Circle
      Circle = new Circle(x, r);
      
      // Create a Rectangle
      Rectangle3d rect = new Rectangle3d(Plane.WorldXY, x, y);
      Rectangle = rect;
    }
    catch(Exception ex)
    {
      // Handle exceptions
      this.Print("An error occurred: " + ex.Message);
    }
  }
}
# ---------- end _2d_geometries ----------
panel = Panel(_2d_geometries.Line)
geometry = Geometry(_2d_geometries.Rectangle)
geometry_2 = Geometry(_2d_geometries.Line)
geometry_3 = Geometry(_2d_geometries.Curve)
geometry_4 = Geometry(_2d_geometries.Circle)
entwine = Entwine(Branch00=geometry_2, Branch01=geometry_3, Branch02=geometry_4, Branch03=geometry, FlattenInputs=True)
panel_2 = Panel(entwine)
