# Grasshopper definition 08.06.03. 3D Geometry_FinalDraft.gh (Grasshopper 1.0.7)
# plug-ins: RhinoCodePluginGH, Bifocals

# This Grasshopper definition
# was developed by Michael Wickerson
# ✉ https://wickersonstudios.com/contact
# 08.06. C# and Chat GPT-4
# Copyright (C) 2023 - LEARNGRASSHOPPER.COM
# 08.06.03. 3D Geometry
# Simple scripts: Cube, Cylinder
# gpt-4 Initial Response
# gpt-4 Text Prompt
# Sure, based on the provided script template,
# you can create a script for a Grasshopper C#
# component in Rhino that can create cubes and
# cylinders. You’ll need to set up the input and
# output parameters properly, and you can include
#  parameters like the size of the cubes and the
# radius and height for the cylinders.
# 
# Below is a sample Grasshopper C# script which
# takes in points, size for the cube, and radius &
# height for the cylinder and creates cubes and
# cylinders at the specified points:
# Use this script editor template to create a script
#  for the C# node in grasshopper for rhino8 that
# models geometry for
# 
# GEOMETRY
# 
# and specifically to
# 
# create cubes and cylinders
# 
# //Grasshopper Script Instance
# //#! csharp
# using System;
# using System.Collections;
# using System.Collections.Generic;
# using System.Drawing;
# 
# using Rhino;
# using Rhino.Geometry;
# 
# using Grasshopper;
# using Grasshopper.Kernel;
# using Grasshopper.Kernel.Data;
# using Grasshopper.Kernel.Types;
# 
# public class Script_Instance : GH_ScriptInstance
# {
#   /*
#     Members:
#       RhinoDoc RhinoDocument
#       GH_Document GrasshopperDocument
#       IGH_Component Component
#       int Iteration
# 
#     Methods (Virtual & overridable):
#       Print(string text)
#       Print(string format, params object[] args)
#       Reflect(object obj)
#       Reflect(object obj, string method_name)
#   */
# 
#   private void RunScript(object x, object y, out object a)
#   {
#     // Write your logic here
#     a = null;
#   }
# }
script = Script()  # -> out, a
# ---------- script: C# ----------
// Grasshopper Script Instance
//#! csharp
using System;
using System.Collections;
using System.Collections.Generic;
using System.Drawing;

using Rhino;
using Rhino.Geometry;

using Grasshopper;
using Grasshopper.Kernel;
using Grasshopper.Kernel.Data;
using Grasshopper.Kernel.Types;

public class Script_Instance : GH_ScriptInstance
{
  /* 
    Members:
      RhinoDoc RhinoDocument
      GH_Document GrasshopperDocument
      IGH_Component Component
      int Iteration

    Methods (Virtual & overridable):
      Print(string text)
      Print(string format, params object[] args)
      Reflect(object obj)
      Reflect(object obj, string method_name)
  */
  
  private void RunScript(object x, object y, out object a)
  {
    // Write your logic here
    a = null;
  }
}
# ---------- end script ----------

# ----
# BASIC SCRIPT
number_slider = Slider(1.76, range=0..10)
# 2nd gpt-4 Text Prompt
# gpt-4 Initial Response
# Doubleclick Me!
# Great, now make the script much more complex model
# with C# script and Rhino common API.
# 
# Be sure to incorporate the previous code logic.
# ensure that this script produces 3d geometry as
# well for Data visualization purposes.
# gpt-4 Transcript link:
# 
# https://chat.openai.com/share/d4eb1200-e813-4a2f-8eee-99bb2d2329c3
number_slider_2 = Slider(0.73, range=0..10)
series = Series(Start=0, Step=1, Count=10)
construct_point = ConstructPoint(XCoordinate=series, YCoordinate=0, ZCoordinate=0)
_3d_geometries = Script(points=construct_point, cubeSize=number_slider, cylRadius=Slider(1.12, range=0..10), cylHeight=number_slider_2)  # -> out, cubes, cylinders; inputs points: list of Point3d, cubeSize: Double, cylRadius: Double, cylHeight: Double
# ---------- _3d_geometries: C# ----------
// Grasshopper Script Instance
//#! csharp
using System;
using System.Collections;
using System.Collections.Generic;
using System.Drawing;

using Rhino;
using Rhino.Geometry;

using Grasshopper;
using Grasshopper.Kernel;
using Grasshopper.Kernel.Data;
using Grasshopper.Kernel.Types;

using System.Linq;

public class Script_Instance : GH_ScriptInstance
{
  private void RunScript(System.Collections.Generic.IEnumerable<Rhino.Geometry.Point3d> points, double cubeSize, double cylRadius, double cylHeight, out object cubes, out object cylinders)
  {
    cubes = points.Select(pt =>
    {
      Plane basePlane = new Plane(pt, Vector3d.ZAxis);
      Interval interval = new Interval(-cubeSize * 0.5, cubeSize * 0.5);
      return new Box(basePlane, interval, interval, interval);
    }).ToList();
    
    cylinders = points.Select(pt =>
    {
      Plane basePlane = new Plane(pt, Vector3d.ZAxis);
      Circle baseCircle = new Circle(basePlane, cylRadius);
      return new Cylinder(baseCircle, cylHeight);
    }).ToList();
  }
}
# ---------- end _3d_geometries ----------
panel = Panel(_3d_geometries.out)
geometry = Geometry(_3d_geometries.cubes)
geometry_2 = Geometry(_3d_geometries.cylinders)
entwine = Entwine(Branch00=geometry, Branch01=geometry_2, FlattenInputs=True)
panel_2 = Panel(entwine)
