# Grasshopper definition 08.06.04. Lists and data tree_FinalDraft_test.gh (Grasshopper 1.0.7)
# plug-ins: RhinoCodePluginGH, Bifocals

# This Grasshopper definition
# was developed by Michael Wickerson
# ✉ https://wickersonstudios.com/contact
# 08.06. C# and Chat GPT-4
# Copyright (C) 2023 - LEARNGRASSHOPPER.COM
# 08.06.04. Lists and data tree
# Simple scripts:Lists and Datatrees
# gpt-4 Initial Response
# gpt-4 Text Prompt
# Use this script editor template to create a script
#  for the C# node in grasshopper for rhino8 that
# models geometry for
# 
# GEOMETRY
# 
# and specifically to
# 
# create lists and datatree outputs
# 
# //Grasshopper Script Instance
# //#! csharp
# using System;
# using System.Collections;
# using System.Collections.Generic;
# using System.Drawing;
# 
# using Rhino;
# using Rhino.Geometry;
# 
# using Grasshopper;
# using Grasshopper.Kernel;
# using Grasshopper.Kernel.Data;
# using Grasshopper.Kernel.Types;
# 
# public class Script_Instance : GH_ScriptInstance
# {
#   /*
#     Members:
#       RhinoDoc RhinoDocument
#       GH_Document GrasshopperDocument
#       IGH_Component Component
#       int Iteration
# 
#     Methods (Virtual & overridable):
#       Print(string text)
#       Print(string format, params object[] args)
#       Reflect(object obj)
#       Reflect(object obj, string method_name)
#   */
# 
#   private void RunScript(object x, object y, out object a)
#   {
#     // Write your logic here
#     a = null;
#   }
# }
script = Script()  # -> out, a
# ---------- script: C# ----------
// Grasshopper Script Instance
//#! csharp
using System;
using System.Collections;
using System.Collections.Generic;
using System.Drawing;

using Rhino;
using Rhino.Geometry;

using Grasshopper;
using Grasshopper.Kernel;
using Grasshopper.Kernel.Data;
using Grasshopper.Kernel.Types;

public class Script_Instance : GH_ScriptInstance
{
  /* 
    Members:
      RhinoDoc RhinoDocument
      GH_Document GrasshopperDocument
      IGH_Component Component
      int Iteration

    Methods (Virtual & overridable):
      Print(string text)
      Print(string format, params object[] args)
      Reflect(object obj)
      Reflect(object obj, string method_name)
  */
  
  private void RunScript(object x, object y, out object a)
  {
    // Write your logic here
    a = null;
  }
}
# ---------- end script ----------
# To accomplish the task, you can modify the
# given template to create some geometry, like
# points and curves, and then store them in lists
# and data trees. Below is a more detailed version
# of the provided template, which creates a list of
# points and a data tree of lines:
# BASIC SCRIPT
script_2 = Script()  # -> out, A, B
# ---------- script_2: C# ----------
// Grasshopper Script Instance
//#! csharp
using System;
using System.Collections;
using System.Collections.Generic;
using System.Drawing;

using Rhino;
using Rhino.Geometry;

using Grasshopper;
using Grasshopper.Kernel;
using Grasshopper.Kernel.Data;
using Grasshopper.Kernel.Types;

using System;
using System.Collections;
using System.Collections.Generic;
using Grasshopper.Kernel;
using Rhino.Geometry;

public class Script_Instance : GH_ScriptInstance
{
    private void RunScript(object x, object y, out object A, out object B)
    {
        // Initialize the list for points
        List<Point3d> pointsList = new List<Point3d>();

        // Initialize the DataTree for lines
        DataTree<Line> linesTree = new DataTree<Line>();
        
        // Number of branches and lines you want to create for example purpose
        int numberOfBranches = 10;
        int numberOfLinesPerBranch = 5;

        // The radius for arranging the branches in a circular pattern
        double radius = 10.0;

        for (int i = 0; i < numberOfBranches; i++)
        {
            // Angle between each branch when arranging in a circular pattern
            double angle = 2 * Math.PI * i / numberOfBranches;
            
            // Calculate the center point of each branch based on the circular pattern
            Point3d centerPt = new Point3d(radius * Math.Cos(angle), radius * Math.Sin(angle), 0);
            pointsList.Add(centerPt);

            // Create a path for the current branch in the data tree
            GH_Path path = new GH_Path(i);

            for (int j = 0; j < numberOfLinesPerBranch; j++)
            {
                // Length and direction of each line in the branch
                double length = 2.0;
                Vector3d direction = new Vector3d(Math.Cos(j * 2 * Math.PI / numberOfLinesPerBranch), Math.Sin(j * 2 * Math.PI / numberOfLinesPerBranch), 0);

                // Create a line and add it to the current branch of the data tree
                Line ln = new Line(centerPt, centerPt + length * direction);
                linesTree.Add(ln, path);
            }
        }
        
        // Assign the created list and data tree to the output parameters
        A = pointsList;
        B = linesTree;
    }
}
# ---------- end script_2 ----------
geometry = Geometry(script_2.A)
# 2nd gpt-4 Text Prompt
# gpt-4 Initial Response
# Doubleclick Me!
# Great, now make the script much more complex model
# with C# script and Rhino common API.
# 
# Be sure to incorporate the previous code logic.
# ensure that this script produces 3d geometry as
# well for Data visualization purposes.
# gpt-4 Transcript link:
# 
# https://chat.openai.com/share/9277abae-e20c-457e-9f3d-01de77dc42bc
geometry_2 = Geometry(script_2.B)
panel = Panel(script_2.out)
entwine = Entwine(Branch00=geometry, Branch01=geometry_2, FlattenInputs=True)
panel_2 = Panel(entwine)
